# Grasshopper definition recursion_on_mesh.gh (Grasshopper 1.0.7)
# plug-ins: Sampler, Heteroptera

number_slider = Slider(2, range=0..10)
msphereex = MeshSphereEx(Base=PlaneXY(0, 0, 0), Radius=number_slider, Count=number_slider)
tri = Triangulate(Mesh=msphereex)  # -> Mesh, Count

# ---- group: Recursive Triangle center subdivision
number_slider_2 = Slider(1.8, range=-2..1.8)
number_slider_3 = Slider(3, range=2..7)
number_slider_4 = Slider(2, range=-2..2)
c_script = CSharpScript(iMesh=tri.Mesh, iRecursionLevel=number_slider_3, ioffsetDepth1=number_slider_2, ioffsetDepth2=number_slider_4)  # -> out, A; inputs iMesh: Mesh, iRecursionLevel: Int32, ioffsetDepth1: Double, ioffsetDepth2: Double
# ---------- c_script: C# usings ----------
using System.Linq; //LINQ offers a common syntax for querying any type of data sources.
//LINQ to SQL is a technology that provides a run-time infrastructure for managing relational data as objects.
# ---------- c_script: C# ----------
    A = subdivide(iMesh, iRecursionLevel, ioffsetDepth1, ioffsetDepth2); //calling the function for Mesh
# ---------- c_script: C# additional code ----------
  public Mesh mesh2; //mesh class in Grasshopper


  //the main function to create a fractal mesh
  public Mesh subdivide (Mesh iMesh, int iRecursionLevel, double ioffsetDepth1, double ioffsetDepth2) //arguments ar emesh itself, and numerical values
  {

    var mesh2 = new Mesh(); //mesh declaration
    var vtx = iMesh.Vertices.ToPoint3dArray(); //vertices of mesh declaration as an array

    
    //containter for vertices
    foreach (var i in Enumerable.Range(0, iMesh.Vertices.Count)){ //taken from Linq iMesh.Vertices.Count. For each vertex on the mesh
      var vtx2 = vtx[i] + new Vector3d(iMesh.Normals[i]) * ioffsetDepth1;//offset vertex in the direction of the normal vector
      mesh2.Vertices.Add(vtx2); //put the vertices taht have been ofsett in the list
    }


    //container for faces
    foreach (var i in Enumerable.Range(0, iMesh.Faces.Count)) { // the same thing for faces, for each face on the mesh

      if (iMesh.Faces[i].IsQuad) { //check whether the mesh is quad or not, boolean property
        mesh2.Faces.AddFace(iMesh.Faces[i]);//put original face, if yes, divide it into two faces, so make it triangular in other words.

      }else{ //if not, go for triangular mesh, triangular face after second iteration. 

        var vidx1 = iMesh.Faces[i].A; //declaration for face A, we are still inside the loop [i]
        var vidx2 = iMesh.Faces[i].B; //declaration for face B
        var vidx3 = iMesh.Faces[i].C; //declaration for face C

        var v1 = vtx[vidx1]; //vertices for face A
        var v2 = vtx[vidx2]; //vertices for face B
        var v3 = vtx[vidx3]; //vertices for face C

        var v4 = (v1 + v2 + v3) / 3; //center point of the face using interpolation method
        //multiplying the vector with some numerical value
        v4 += Vector3d.Multiply(iMesh.FaceNormals[i], ioffsetDepth2); //offset new vertex and add it into the original set considering the user-defined numerical factor.

        var vidx4 = mesh2.Vertices.Add(v4);//add new vertex, create face D and get index number

        
        //to create a mesh we need faces
        mesh2.Faces.AddFace(vidx1, vidx2, vidx4); //subdivided face based on previous faces
        mesh2.Faces.AddFace(vidx2, vidx3, vidx4);//subdivided face
        mesh2.Faces.AddFace(vidx3, vidx1, vidx4);//subdivided face

      }
    }

    mesh2.Normals.ComputeNormals();//compute again the new normals for next iteration using Rhino common

    if (iRecursionLevel > 1)
      //calling the function from within - this is a recursion  
      return subdivide(mesh2, iRecursionLevel - 1, ioffsetDepth1 / 2, ioffsetDepth2 / 2); //recursion function. It calls itself from inside.
    return mesh2;
  }
# ---------- end c_script ----------
panel = Panel(c_script.A)
mesh = Mesh(c_script.A)

# ----
path = FilePath("E:\AI\AI_Game\Recursive_test\stored_values\Fractals")
sampler = Sampler(
    Variables=[number_slider_3, number_slider_2, number_slider_4],
    Samples=Slider(1200, range=0..10000),
    Type=2,
    Seed=Slider(25192, range=0..100000),
    Filename="Fractals",
    Directory=path)  # -> DesignMap, Data

# ---- group: Animate this and the files will be stored as OBJ
number_slider_5 = Slider(1199, range=0..1199)
concat = Concatenate(FragmentA="{", FragmentB=number_slider_5, FragmentC="}")
panel_2 = Panel(concat)

# ----
series = Series(Start=Slider(0, range=0..100), Step=Slider(1, range=0..1), Count=Slider(3, range=0..10))
item = TreeItem(Tree=sampler.DesignMap, Path=concat, Index=series, Wrap=True)
panel_3 = Panel(item)
item_2 = ListItem(List=item, Index=0, Wrap=True)  # -> Item, Item1, Item2
c_script_2 = CSharpScript(iMesh=tri.Mesh, iRecursionLevel=item_2.Item, ioffsetDepth1=item_2.Item1, ioffsetDepth2=item_2.Item2)  # -> out, A; inputs iMesh: Mesh, iRecursionLevel: Int32, ioffsetDepth1: Double, ioffsetDepth2: Double
# ---------- c_script_2: C# usings ----------
using System.Linq;
# ---------- c_script_2: C# ----------
    A = subdivide(iMesh, iRecursionLevel, ioffsetDepth1, ioffsetDepth2);
# ---------- c_script_2: C# additional code ----------
  public Mesh mesh2;

  public Mesh subdivide (Mesh iMesh, int iRecursionLevel, double ioffsetDepth1, double ioffsetDepth2)
  {

    var mesh2 = new Mesh();
    var vtx = iMesh.Vertices.ToPoint3dArray();

    foreach (var i in Enumerable.Range(0, iMesh.Vertices.Count)){ //taken from Linq iMesh.Vertices.Count
      var vtx2 = vtx[i] + new Vector3d(iMesh.Normals[i]) * ioffsetDepth1;//offset vertex, basically attractor vector
      mesh2.Vertices.Add(vtx2);
    }


    foreach (var i in Enumerable.Range(0, iMesh.Faces.Count)) {

      if (iMesh.Faces[i].IsQuad) {
        mesh2.Faces.AddFace(iMesh.Faces[i]);//put original face

      }else{ //go for triangular mesh

        var vidx1 = iMesh.Faces[i].A;
        var vidx2 = iMesh.Faces[i].B;
        var vidx3 = iMesh.Faces[i].C;

        var v1 = vtx[vidx1];
        var v2 = vtx[vidx2];
        var v3 = vtx[vidx3];
        var v4 = (v1 + v2 + v3) / 3; //center point
        v4 += Vector3d.Multiply(iMesh.FaceNormals[i], ioffsetDepth2); //offset new vertex and add it into original set.

        var vidx4 = mesh2.Vertices.Add(v4);//add new vertex and get index number
        mesh2.Faces.AddFace(vidx1, vidx2, vidx4); //subdivided face
        mesh2.Faces.AddFace(vidx2, vidx3, vidx4);//subdivided face
        mesh2.Faces.AddFace(vidx3, vidx1, vidx4);//subdivided face

      }
    }

    mesh2.Normals.ComputeNormals();

    if (iRecursionLevel > 1)
      return subdivide(mesh2, iRecursionLevel - 1, ioffsetDepth1 / 2, ioffsetDepth2 / 2); //recursion function. It calls itself from inside.
    return mesh2;
  }
# ---------- end c_script_2 ----------
mesh_2 = Mesh(c_script_2.A)
concat_2 = Concatenate(FragmentA=number_slider_5, FragmentB="_fractal")
baking_capture = CaptureBaked(Geometrical=flatten(mesh_2), Activate=Toggle(False), Path="C:/Capture", Filename="Anishade", Ext=0, Reset=Button())
python = GhPythonScript(mesh=mesh_2, path=path, filename=concat_2)  # -> out, a; inputs mesh: Mesh; disabled
# ---------- python: Python ----------
import rhinoscriptsyntax as rs
import os

def export_obj(mesh, path, filename): #create OBJ file which has a specific hierarchy

    obj_fname = "%s.%s" %(filename, "obj")#definition of the file name
    mtl_fname = "%s.%s" %(filename, "mtl")# material definition if necessary
    obj_fpath = os.path.join(path, obj_fname)#path to store the file
    
    header = "# Rhino\n\nmtllib %s\ng %s\nusemtl diffuse_0_0_0_255\n" \
    %(mtl_fname, "object_1")
        
    with open(obj_fpath, 'w') as f:
        f.write(header) #write the header to the file
        
        for vtx in mesh.Vertices:
            f.write("v %.4f %.4f %.4f\n" %(vtx.X, vtx.Y, vtx.Z)) #write the vertexes
            
        for uv in mesh.TextureCoordinates:
            f.write("vt %.2f %.2f\n" %(uv[0], uv[1]))
            
        for vec in mesh.Normals:#write the orientation of the faces
            f.write("vn %.4f %.4f %.4f\n" %(vec.X, vec.Y, vec.Z))
            
        for face in mesh.Faces: #write the faces for the newly created mesh
            f.write ("f")   
           
            for i in face:
                f.write(" %d/%d/%d" %(i+1, i+1, i+1))
            f.write("\n")
            
export_obj(mesh, path, filename) # calling the function, export it as obj, within certain path and name the file
# ---------- end python ----------
panel_4 = Panel(python.out)
